# Grasshopper definition unnamed.gh (Grasshopper 1.0.8)
# plug-ins: Dynamic Code Bridge

cs_bridge = DynamicCSharpBridge(
    CurrentPath="C:\Users\nacho\.gemini\antigravity\scratch\IAAC_Plugin\iaac\scripts\TEST\bridge_logic.cs",
    IsInternalized=False,
    LastCode="""/* 
   ===========================================================================
   DYNAMIC C# BRIDGE - MASTER MANUAL & AI SYSTEM PROMPT v4.0
   ===========================================================================
   
   INSTRUCTIONS:
   1. LINK: Connect this file path to the 'P' input of the Bridge component.
   2. SYNC: Save this file (Ctrl+S) and Grasshopper updates instantly.
   3. AI LOOP: Copy the prompt below to ChatGPT/Gemini to generate code.
   
   DEBUGGING:
   This bridge generates a unique log: 'bridge_status_[ID].log'.
   If you get an error, provide this log to your AI Assistant.
   The AI will read the stack trace and fix the logic for you.
   
   ---------------------------------------------------------------------------
   [ COPY-PASTE THIS SYSTEM PROMPT TO YOUR AI ASSISTANT ]
   ---------------------------------------------------------------------------
   "You are an expert Rhino/Grasshopper C# Developer. I am using the 'Dynamic 
   Code Bridge'. This system uses an external .cs file to control a 
   Grasshopper component via meta-programming.
   
   RULES FOR GENERATING CODE:
   1. PARAMETERS: Start the file with tags: // IN: Name or // OUT: Name.
   2. LIBRARIES: Use 'using Rhino.Geometry;' and 'using Grasshopper.Kernel.Types;'.
   3. DATA ACCESS: Use the 'Inputs["Name"]' dictionary to read values.
   4. TYPE CHECKING: Use 'is GH_Number', 'is GH_Point', etc., to unwrap data.
   5. OUTPUTS: Assign results to variables matching your // OUT tags.
   
   TASK: Generate a script that [DESCRIBE YOUR GOAL HERE]"
   ---------------------------------------------------------------------------
*/

// IN: Radius
// OUT: MySphere

using System;
using System.Collections.Generic;
using Rhino.Geometry;
using Grasshopper.Kernel.Types;

// --- LIVE EXECUTION AREA ---

double r = 1.0;

// 1. Retrieve & Unwrap Input (AI Pattern)
if (Inputs.ContainsKey("Radius") && Inputs["Radius"] is GH_Number ghn) {
    r = ghn.Value;
} else if (Inputs.ContainsKey("Radius") && Inputs["Radius"] != null) {
    try { r = Convert.ToDouble(Inputs["Radius"]); } catch { }
}

// 2. Logic (AI Pattern)
Sphere sphere = new Sphere(Point3d.Origin, Math.Max(0.1, r));

// 3. Assign to Output (Matches // OUT: MySphere)
var MySphere = sphere;

// Return execution info
$"C# Bridge: Generated Sphere with Radius {r:F2}"
""")  # -> Output, MySphere
py_bridge = DynamicPythonBridge(
    CurrentPath="C:\Users\nacho\.gemini\antigravity\scratch\IAAC_Plugin\iaac\scripts\TEST\bridge_logic.py",
    IsInternalized=False,
    LastCode="""# !python3
# r: numpy

# IN: Count, Width, Height
# OUT: PointCloud, Status

import Rhino.Geometry as rg
import random

# 1. COMPATIBILITY LAYER
Inputs = dict(Inputs)

def get_num(key, default):
    val = Inputs.get(key)
    if val is None: return default
    return val.Value if hasattr(val, 'Value') else val

try:
    import numpy as np
    
    # 2. INPUTS
    c = int(get_num('Count', 50))
    w = float(get_num('Width', 50.0))
    h = float(get_num('Height', 20.0))

    # 3. LOGIC
    x = np.random.uniform(0, w, c)
    y = np.random.uniform(0, h, c)
    z = np.sin(x * 0.2) * 5.0
    
    PointCloud = [rg.Point3d(xi, yi, zi) for xi, yi, zi in zip(x, y, z)]
    Status = "Python 1.3.1: Success. Generated {0} points.".format(c)

except Exception as e:
    raise e

print(Status)
"Status: Ready"
""")  # -> Output, PointCloud, Status
panel = Panel(py_bridge.Output)
panel_2 = Panel(cs_bridge.Output)
